# Grasshopper definition crb15000_robot_control.ghx (Grasshopper 1.0.7)

reload = Button()
path = PythonScript()  # -> HERE, DATA, ROBOT_DESCRIPTION
# ---------- path: Python ----------
import os

HERE = os.path.dirname(ghdoc.Path)
DATA = os.path.abspath(os.path.join(HERE, "..", "data"))
ROBOT_DESCRIPTION = os.path.abspath(os.path.join(DATA, "robot_description"))

print(HERE)
print(DATA)
print(ROBOT_DESCRIPTION)
# ---------- end path ----------
py = PythonScript(reload=reload)
# ---------- py: Python ----------
from compas_ghpython import unload_modules

if reload:
    unload_modules("fabtory_fabrication_control")
    unload_modules("compas_rrc")
    unload_modules("crb15000_control")
# ---------- end py ----------

# ----
# ROS client
ip = ValueList({"127.0.0.1", "192.168.0.4", "10.181.79.113"}, selected="127.0.0.1")
robot_port = ValueList({"9090", "30101"}, selected="9090")
ros = ROSConnect(ip=ip, port=robot_port, connect=Toggle(True))  # -> ros_client, is_connected; inputs port: Int32, connect: Boolean
#   port ip: The ip address ROS. Defaults to 127.0.0.1.
# ---------- ros: Python ----------
from ghpythonlib.componentbase import executingcomponent as component
from scriptcontext import sticky as st

from compas_fab.backends import RosClient
from compas_fab.ghpython.components import create_id


class ROSConnect(component):
    def RunScript(self, ip, port, connect):
        ros_client = None

        ip = ip or '127.0.0.1'
        port = port or 9090

        key = create_id(self, 'ros_client')
        ros_client = st.get(key, None)

        if ros_client:
            st[key].close()
        if connect:
            st[key] = RosClient(ip, port)
            st[key].run(5)

        ros_client = st.get(key, None)
        is_connected = ros_client.is_connected if ros_client else False
        return (ros_client, is_connected)
# ---------- end ros ----------
is_connected = Panel(ros.is_connected)

abb = GhPythonScript(ros_client=ros.ros_client, connect=Toggle(True))  # -> out, abb_client; inputs connect: Boolean
# ---------- abb: Python ----------
import compas_rrc as rrc

if ros_client:
    if ros_client.is_connected and connect: 
        # Create ABB Client
        abb_client = rrc.AbbClient(ros_client, '/rob1')
# ---------- end abb ----------
x_axis = Curve(<curve referenced from the Rhino model>)
y_axis = Curve(<curve referenced from the Rhino model>)
plane = PythonScript(plane_axes=[x_axis, y_axis])  # -> plane; inputs plane_axes: list of Curve
# ---------- plane: Python ----------
import Rhino.Geometry as rg

x_axis, y_axis = plane_axes

x_axis = rg.Line(x_axis.PointAtStart, x_axis.PointAtEnd)
y_axis = rg.Line(y_axis.PointAtStart, y_axis.PointAtEnd)

if x_axis.From.DistanceTo(y_axis.From) < 0.01:
    origin = x_axis.From
    xvec = x_axis.Direction
    yvec = y_axis.Direction
elif x_axis.To.DistanceTo(y_axis.To) < 0.01:
    origin = x_axis.To
    xvec = -x_axis.Direction
    yvec = -y_axis.Direction
elif x_axis.From.DistanceTo(y_axis.To) < 0.01:
    origin = x_axis.From
    xvec = x_axis.Direction
    yvec = -y_axis.Direction
elif x_axis.To.DistanceTo(y_axis.From) < 0.01:
    origin = x_axis.To
    xvec = -x_axis.Direction
    yvec = y_axis.Direction

plane = rg.Plane(origin, xvec, yvec)
# ---------- end plane ----------
python = GhPythonScript(plane=plane, num=Slider(10, range=0..10), dist=Slider(0.1, range=0..1))  # -> out, planes; inputs plane: Plane, num: Int32
# ---------- python: Python ----------
from compas.geometry import Frame, Translation, Vector
from compas.artists import Artist

frames = []
planes = []

for i in range(num):
    frame = Frame(plane.Origin, plane.XAxis, plane.YAxis)
    print dist*i
    T = Translation.from_vector(Vector.Yaxis()*dist*i)
    frame.transform(T)
    print frame
    frames.append(frame)
    planes.append(Artist(frame).draw())
# ---------- end python ----------
crv = Curve(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)
frames = CurveFrames(Curve=crv, Count=Slider(3, range=0..10))  # -> Frames, Parameters
item = ListItem(List=frames.Frames, Index=Slider(0, range=0..4), Wrap=True)

to_robtarget = Button()
to_plane = Button()

to_planes = Button()
planes = Plane(frames.Frames)

get_frame = Button()
get_robtarget = Button()
get_joints = Button()

# ----
# Tool
panel = Panel("Attach a custom tool")
list = ValueList({"measurement_tool": 0, "sgraffito_tool": 1}, selected="sgraffito_tool")
remove = Button()
add = Button()
tools = Tools(G=list)

# ----
# Load Model
# Load robot from local package
load = Button()
list_2 = ValueList({"abb_crb15000"}, selected="abb_crb15000")
units = ValueList({"m": 1, "cm": 100, "mm": 1000}, selected="m")

# ----
# Robot Model
panel_2 = Panel("abb_crb15000_5_95.srdf")

load_model = PythonScript(
    path=path.ROBOT_DESCRIPTION,
    package=list_2,
    urdf_name="abb_crb15000_5_95.urdf",
    srdf_name=panel_2,
    scale_factor=units,
    load=load)  # -> robot
# ---------- load_model: Python ----------
import os
from scriptcontext import sticky as st
import compas
from compas.robots import RobotModel
from compas.robots import LocalPackageMeshLoader
from compas_fab.robots import Robot
from compas_fab.robots import RobotSemantics
from compas_fab.ghpython import RobotArtist

packages = ["abb_crb15000_support", "abb_end_effectors", "abb_crb15000"]
loaders = []

for package in packages:
    loaders.append(LocalPackageMeshLoader(path, package))

#path directory
package_path = os.path.join(path, package)
print(package_path)

urdf_filename = os.path.join(package_path, "urdf", urdf_name)
srdf_filename = os.path.join(package_path, srdf_name)

assert os.path.isfile(urdf_filename)
assert os.path.isfile(srdf_filename)

compas.PRECISION = '12f'

# store robot in component
guid = str(ghenv.Component.InstanceGuid)
robot_key = "robot_" + guid

if robot_key not in st:
    st[robot_key] = None

#load robot model from urdf
if load:
    model = RobotModel.from_urdf_file(urdf_filename)
    model.load_geometry(*loaders)
    artist = RobotArtist(model)
    semantics = RobotSemantics.from_srdf_file(srdf_filename, model)
    robot = Robot(model, artist, semantics, client=None)

    st[robot_key] = robot
robot = st[robot_key]

#vizualize robot in the right scale of your environment
robot.scale(scale_factor)
# ---------- end load_model ----------

attach_remove = PythonScript(robot=load_model, tool=tools, attach=add, remove=remove)  # -> out, bang
# ---------- attach_remove: Python ----------
if attach:
    robot.attach_tool(tool)
if remove:
    robot.detach_tool()
# ---------- end attach_remove ----------

set = PythonScript(robot=load_model, ros_client=ros.ros_client, abb_client=abb.abb_client)  # -> out, robot, main_group_name
# ---------- set: Python ----------
if robot and ros_client and abb_client:
    robot.ros_client = ros_client
    robot.abb_client = abb_client

    robot.info()
    main_group_name = robot.main_group_name
# ---------- end set ----------
robot_info = Panel(set.out)

# ----
# Configuration
# Forward kinematics
number_slider = Slider(-6.3, range=-180..180)
jp = GhPythonScript()  # -> configuration_values
# ---------- jp: Python ----------
import math
joint_values = [-3.136, -0.328, -1.218, 3.129, 0.852, 0.008]
#joint_values = [math.degrees(j) for j in joint_values]
#joint_positions = [0] * 6


joint_values = [0,0,0,0,0,0]

configuration_values = joint_values
# ---------- end jp ----------
forward_kinematics = PythonScript(
    robot=set.robot,
    reset_configuration=Button(),
    configuration_values=jp,
    a_a1=number_slider,
    a_a2=Slider(10, range=-90..150),
    a_a3=Slider(3.2, range=-180..180),
    a_a4=Slider(-1.8, range=-400..400),
    a_a5=Slider(3.2, range=-125..120),
    a_a6=Slider(82.4, range=-400..400))  # -> full_configuration; inputs reset_configuration: Boolean, configuration_values: list
# ---------- forward_kinematics: Python ----------
import math
import Grasshopper
import copy
from compas.robots import Joint
from compas_fab.robots import Configuration





if reset_configuration:
    j = 0
    for i in range(ghenv.Component.Params.Input.Count):
        nslider = ghenv.Component.Params.Input[i].Sources[0]
        if nslider.GetType() == Grasshopper.Kernel.Special.GH_NumberSlider:
            nslider.TrySetSliderValue(configuration_values[j])
            j += 1


if robot:
    joint_positions = [a_a1, a_a2, a_a3, a_a4, a_a5, a_a6]
    print joint_positions
    joint_positions_degrees = copy.deepcopy(joint_positions)
    joint_types = robot.get_configurable_joint_types()
    print(joint_types)
    for i, joint_type in enumerate(joint_types):
        if joint_type == Joint.REVOLUTE:
            joint_positions[i] = math.radians(joint_positions[i])
        if joint_type == Joint.PRISMATIC:
            joint_positions[i] = joint_positions[i]
    full_configuration = Configuration(joint_positions, joint_types)
    print full_configuration
# ---------- end forward_kinematics ----------

# ----
# Inverse kinematics
py_2 = PythonScript(robot=set.robot)  # -> configuration
# ---------- py_2: Python ----------
from compas_fab.robots import Configuration

if robot:
    types = robot.get_configurable_joint_types()
    values = [0] * len(types)
    configuration = Configuration(values, types)
    print configuration
    print robot.get_configurable_joint_names()
# ---------- end py_2 ----------
x_axis_2 = Curve(<curve referenced from the Rhino model>)
y_axis_2 = Curve(<curve referenced from the Rhino model>)
fk_configuration = Data(forward_kinematics)
go_to_start_configuration = BooleanToggle(False)
list_3 = ValueList({"0", "1"}, selected="1")
avoid_collisions = BooleanToggle(False)
plane_2 = PythonScript(plane_axes=[x_axis_2, y_axis_2])  # -> plane; inputs plane_axes: list of Curve; same code as plane
compute = BooleanToggle(True)
filter = StreamFilter(Gate=list_3, Stream0=fk_configuration, Stream1=py_2)
inverse_kinematics = GhPythonScript(
    compute=compute,
    robot=set.robot,
    group=set.main_group_name,
    plane=item,
    start_configuration=filter,
    go_to_start_configuration=go_to_start_configuration,
    avoid_collisions=avoid_collisions)  # -> out, ik_configuration, t0cp; inputs plane: Plane
# ---------- inverse_kinematics: Python ----------
from __future__ import print_function
import logging
from scriptcontext import sticky as st

from compas.geometry import Frame
from compas_ghpython.artists import Artist

LOGGER = logging.getLogger('roslibpy')

#vizualize t0cf
if robot.attached_tool:
    t0cf = Frame(plane.Origin, plane.XAxis, plane.YAxis)
    t0cf = robot.from_tcf_to_t0cf([t0cf])[0]
    t0cp = Artist(t0cf).draw()
    print (t0cf)


if compute:
    if robot.attached_tool:
        tool_attached = True
    else:
        tool_attached = False

    robot.client = robot.ros_client
    if go_to_start_configuration:
        ik_configuration = start_configuration
    else:
        frame = Frame(plane.Origin, plane.XAxis, plane.YAxis)
        if tool_attached:
            tool_frame = robot.from_tcf_to_t0cf([frame])[0]
        else:
            tool_frame = frame

        ik_configuration = robot.inverse_kinematics(tool_frame,
                                                      start_configuration,
                                                      group=group,
                                                      options={
                                                        'avoid_collisions':avoid_collisions,
                                                        'return_full_configuration':True,
                                                      })        
    #group_configuration = robot.get_group_configuration(group, ik_configuration)
    #print (group_configuration)
    st["ik_configuration"] = ik_configuration

ik_configuration = st["ik_configuration"] 
print(ik_configuration)
# ---------- end inverse_kinematics ----------
draw = GhPythonScript(planes=inverse_kinematics.t0cp, scale=Slider(0.2, range=0..1))  # -> P, V, C, W; inputs planes: list
# ---------- draw: Python ----------
from System.Drawing import Color
from compas_ghpython.artists import FrameArtist

red = Color.FromArgb(255, 0, 0)
green = Color.FromArgb(0, 255, 0)
blue = Color.FromArgb(0, 0, 255)

P = []
V = []
C = []

scale = float(scale)

for plane in planes:
    if not plane:
        continue
    P += [plane.Origin] * 3
    V.append(plane.XAxis * scale)
    V.append(plane.YAxis * scale)
    V.append(plane.ZAxis * scale)
    C += [red, green, blue]

W = 3
# ---------- end draw ----------
out = Panel(inverse_kinematics.ik_configuration)
vdisex = VectorDisplayEx(Point=draw.P, Vector=draw.V, Colour=draw.C, Width=draw.W)

list_4 = ValueList({"0 forward_kinematics": 0, "1 inverse_kinematics": 1}, selected="1 inverse_kinematics")
ik_configuration = Data(inverse_kinematics.ik_configuration)
fk_configuration_2 = Data(forward_kinematics)
filter_2 = StreamFilter(Gate=list_4, Stream0=fk_configuration_2, Stream1=ik_configuration)

# ----
# Move Cartesian
tcp_speed = Slider(39, range=0..1000)
target_plane = Plane(item)
movel_command = GhPythonScript(
    robot=set.robot,
    configuration=filter_2,
    speed=tcp_speed,
    target_plane=target_plane,
    planes=planes,
    move_to_planes=to_planes,
    move_to_plane=to_plane,
    move_to_robtarget=to_robtarget,
    set_tool=add)  # -> out, plane, tool_plane; inputs target_plane: Plane, planes: list, move_to_plane: Boolean, move_to_robtarget: Boolean
# ---------- movel_command: Python ----------
import compas_rrc as rrc
import abb_fabrication_control as afc
from compas.geometry import Frame, Rotation
import math
from compas.artists import Artist


#tool_plane = Artist(robot.attached_tool.frame).draw()

#set tool in RobotStudio
if set_tool:
    if robot.attached_tool:
        tool_name = robot.attached_tool.name
        print tool_name
        done = robot.abb_client.send(rrc.SetTool(tool_name))
        print done
    else:
        robot.abb_client.send(rrc.SetTool("tool0"))


if move_to_plane:
    #transform target plane into target frame
    target_frame = Frame(target_plane.Origin, target_plane.XAxis, target_plane.YAxis)
    print target_frame
    #target_frame_trnsf = robot.from_tcf_to_t0cf([target_frame])
    #print target_frame_trnsf[0]
    #send move to frame command
    afc.commands.move_to_frame(robot, target_frame, speed=speed, zone=rrc.Zone.FINE, scalefactor=1000)

target_frames = []
if move_to_planes:
    for target_plane in planes:
        target_frame = Frame(target_plane.Origin, target_plane.XAxis, target_plane.YAxis)
        #T = Rotation.from_axis_angle_vector([1,0,0],target_frame.point)
        #send move to frame command
        afc.commands.move_to_frame(robot, target_frame, speed=speed, zone=rrc.Zone.FINE, scalefactor=1000)
        target_frames.append(target_frame)

#print(len(target_frames))

if move_to_robtarget:
    #transform target plane into target frame
    target_frame = Frame(target_plane.Origin, target_plane.XAxis, target_plane.YAxis)
    #store cart value from configuration
    cart = (configuration.joint_values[0])
    #send move to robtarget command
    afc.commands.move_to_robtarget(robot, target_frame, cart, speed=speed, zone=rrc.Zone.FINE, scalefactor=1000)
# ---------- end movel_command ----------
data_recorder = DataRecorder(movel_command.out, DataLimit=-10, RecordData=True)
out_2 = Panel(data_recorder)
pln = Plane(movel_command.tool_plane)

# ----
# Move Joints
tcp_speed_2 = Slider(39, range=0..1000)
to_joints = Button()
movej_command = GhPythonScript(robot=set.robot, configuration=filter_2, speed=tcp_speed_2, move_to_joints=to_joints)  # -> out; inputs move_to_joints: Boolean
# ---------- movej_command: Python ----------
import abb_fabrication_control as afc
import compas_rrc as rrc



if move_to_joints:
    afc.commands.move_to_joints(robot, configuration, speed=speed, zone=rrc.Zone.FINE)
# ---------- end movej_command ----------
data_recorder_2 = DataRecorder(movej_command, DataLimit=-10, RecordData=True)
out_3 = Panel(data_recorder_2)

# ----
# Visualisation
# Robot Control
show_end_effector_frame = BooleanToggle(True)
show_base_frame = BooleanToggle(False)
show_collision = BooleanToggle(False)
show_frames = BooleanToggle(False)
show_visual = BooleanToggle(True)
show_acm = BooleanToggle(False)
robot_visualize = RobotVisualize(
    robot=set.robot,
    group=set.main_group_name,
    configuration=filter_2,
    redraw=attach_remove.bang,
    show_visual=show_visual,
    show_collision=show_collision,
    show_frames=show_frames,
    show_base_frame=show_base_frame,
    show_end_effector_frame=show_end_effector_frame,
    show_acm=show_acm)  # -> visual, collision, attached_meshes, frames, base_frame, ee_frame; inputs redraw: list, show_visual: Boolean, show_collision: Boolean, show_frames: Boolean, show_base_frame: Boolean, show_end_effector_frame: Boolean, show_acm: Boolean
#   port group: The planning group used for end-effector and base visualization.
#   port configuration: The robot's full configuration.
#   port redraw: A list of attached collision meshes.
#   port show_visual: Whether or not to show the robot's visual meshes.
#   port show_collision: Whether or not to show the robot's collision meshes.
#   port show_frames: Whether or not to show the robot's joint frames.
#   port show_base_frame: Whether or not to show the robot's base frame.
#   port show_end_effector_frame: Whether or not to show the robot's end-effector frame.
#   port show_acm: Whether or not to show the attached collision meshes (if any).
#   port visual: The robot's visual Rhino meshes (if any).
#   port collision: The robot's collision Rhino meshes (if any).
#   port attached_meshes: The attached collision Rhino meshes (if any).
#   port frames: The robot's joint frames as Rhino planes (if any).
#   port base_frame: The robot's base frame as a Rhino plane (if any).
#   port ee_frame: The robot's end-effector frame as a Rhino plane (if any).
# ---------- robot_visualize: Python ----------
"""
Visualizes the robot.

COMPAS FAB v0.19.1
"""
from compas.geometry import Frame
from compas.geometry import Transformation
from compas_ghpython.artists import Artist
from ghpythonlib.componentbase import executingcomponent as component


class RobotVisualize(component):
    def RunScript(self, robot, group, configuration, attached_collision_meshes, show_visual, show_collision,
                  show_frames, show_base_frame, show_end_effector_frame, show_acm):

        visual = None
        collision = None
        attached_meshes = None
        frames = None
        base_frame = None
        ee_frame = None

        if robot:
            show_visual = True if show_visual is None else show_visual
            configuration = configuration or robot.zero_configuration()

            robot.update(configuration, visual=show_visual, collision=show_collision)
            compas_frames = robot.transformed_frames(configuration, group)

            if show_visual:               
                visual = robot.artist.draw_visual()
                

            if show_collision:
                collision = robot.artist.draw_collision()

            if show_base_frame:
                base_compas_frame = compas_frames[0]
                base_frame = Artist(base_compas_frame).draw()

            if show_end_effector_frame:
                ee_compas_frame = robot.forward_kinematics(configuration, group, options=dict(solver='model'))
                if robot.attached_tool:
                    ee_compas_frame = robot.from_t0cf_to_tcf([ee_compas_frame])[0]
                ee_frame = Artist(ee_compas_frame).draw()

            if show_frames:
                frames = []
                for compas_frame in compas_frames[1:]:
                    frame = Artist(compas_frame).draw()
                    frames.append(frame)

            if show_acm:
                attached_meshes = []
                for acm in attached_collision_meshes:
                    frame = robot.forward_kinematics(configuration, options=dict(solver='model', link_name=acm.link_name))
                    T = Transformation.from_frame_to_frame(Frame.worldXY(), frame)
                    mesh = acm.collision_mesh.mesh.transformed(T)
                    attached_meshes.append(Artist(mesh).draw())

        return (visual, collision, attached_meshes, frames, base_frame, ee_frame)
# ---------- end robot_visualize ----------
draw_2 = GhPythonScript(frames=[robot_visualize.frames, robot_visualize.base_frame, robot_visualize.ee_frame], scale=Slider(0.2, range=0..1))  # -> P, V, C, W; inputs frames: list
# ---------- draw_2: Python ----------
from System.Drawing import Color
from compas_ghpython.artists import FrameArtist

red = Color.FromArgb(255, 0, 0)
green = Color.FromArgb(0, 255, 0)
blue = Color.FromArgb(0, 0, 255)

P = []
V = []
C = []

scale = float(scale)

for plane in frames:
    if not plane:
        continue
    P += [plane.Origin] * 3
    V.append(plane.XAxis * scale)
    V.append(plane.YAxis * scale)
    V.append(plane.ZAxis * scale)
    C += [red, green, blue]

W = 3
# ---------- end draw_2 ----------
geo = Geometry([robot_visualize.visual, robot_visualize.collision, robot_visualize.attached_meshes])
preview = CustomPreview(Geometry=geo, Shader=ColourSwatch(SwatchColor=RGB(207, 157, 160)))
vdisex_2 = VectorDisplayEx(Point=draw_2.P, Vector=draw_2.V, Colour=draw_2.C, Width=draw_2.W)

# ----
# Get Robot Configurations
get_joints_2 = GhPythonScript(robot=set.robot, get_frame=get_frame, get_robtarget=get_robtarget, get_joints=get_joints)  # -> joint, current_plane
# ---------- get_joints_2: Python ----------
from scriptcontext import sticky as st
import abb_fabrication_control as afc
import os

from compas_ghpython.artists import Artist

# store robot in component
#guid = str(ghenv.Component.InstanceGuid)
current_frame_key = "current_frame_" #+ guid
current_robtarget_key = "current_robtarget_" #+ guid
current_configuration_key = "current_configuration_" #+ guid

if current_frame_key not in st:
    st[current_frame_key] = None

if current_robtarget_key not in st:
    st[current_robtarget_key] = None

if current_configuration_key not in st:
    st[current_configuration_key] = None


#get commands
if get_frame:
    current_frame = afc.feedback.get_frame(robot, scalefactor=0.001)
    st[current_frame_key] = current_frame

if get_robtarget:
    current_robtarget = afc.feedback.get_robtarget(robot, scalefactor=0.001)
    print current_robtarget
    st[current_robtarget_key] = current_robtarget


if get_joints:
    current_configuration = afc.feedback.get_joints(robot)
    st[current_configuration_key] = current_configuration
    print current_configuration

# sticky
if st[current_frame_key]:
    current_frame = st[current_frame_key]
    current_plane = Artist(current_frame).draw()

if st[current_robtarget_key]:
    current_robtarget = st[current_robtarget_key]

if st[current_configuration_key]:
    current_configuration = st[current_configuration_key]
# ---------- end get_joints_2 ----------
data_recorder_3 = DataRecorder(get_joints_2.joint, DataLimit=-10, RecordData=True)
draw_3 = GhPythonScript(plane=get_joints_2.current_plane, scale=Slider(0.2, range=0..1))  # -> P, V, C, W; inputs plane: Plane
# ---------- draw_3: Python ----------
from System.Drawing import Color
from compas_ghpython.artists import FrameArtist

red = Color.FromArgb(255, 0, 0)
green = Color.FromArgb(0, 255, 0)
blue = Color.FromArgb(0, 0, 255)

P = []
V = []
C = []

scale = float(scale)


if plane:
    P += [plane.Origin] * 3
    V.append(plane.XAxis * scale)
    V.append(plane.YAxis * scale)
    V.append(plane.ZAxis * scale)
    C += [red, green, blue]
    
    W = 3
# ---------- end draw_3 ----------
joint_values = Panel(data_recorder_3)
vdisex_3 = VectorDisplayEx(Point=draw_3.P, Vector=draw_3.V, Colour=draw_3.C, Width=draw_3.W)

# ==== cluster Tools

# ---- group: measurement tool
geo = Geometry(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)
mesh = Mesh(geo)
mjoin = MeshJoin(Meshes=mesh)
xaxis_line = Curve(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)
yaxis_line = Curve(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)
tool = PythonScript(rhmesh=mjoin, xline=xaxis_line, yline=yaxis_line)  # -> tool; inputs rhmesh: Mesh
# ---------- tool: Python ----------
import Rhino.Geometry as rg
import os, math
from compas.geometry import Frame, Rotation
from compas.datastructures import Mesh
from compas_ghpython.artists import MeshArtist
from compas_fab.robots import Tool
from compas_rhino.geometry import RhinoMesh

xaxis = rg.Line(xline.PointAtStart, xline.PointAtEnd)
yaxis = rg.Line(yline.PointAtStart, yline.PointAtEnd)

if xaxis.From.DistanceTo(yaxis.From) < 0.01:
    origin = xaxis.From
    xaxis = xaxis.Direction
    yaxis = yaxis.Direction
elif xaxis.To.DistanceTo(yaxis.To) < 0.01:
    origin = xaxis.To
    xaxis = -xaxis.Direction
    yaxis = -yaxis.Direction
elif xaxis.From.DistanceTo(yaxis.To) < 0.01:
    origin = xaxis.From
    xaxis = xaxis.Direction
    yaxis = -yaxis.Direction
elif xaxis.To.DistanceTo(yaxis.From) < 0.01:
    origin = xaxis.To
    xaxis = -xaxis.Direction
    yaxis = yaxis.Direction

xaxis.Unitize()
yaxis.Unitize()

ee_frame = Frame(origin, xaxis, yaxis)
ee_mesh = RhinoMesh.from_geometry(rhmesh).to_compas()

tool = Tool(ee_mesh, ee_frame, collision=None, name="t_measurement")


values_for_robotstudio = [[round(entry*1000, 5) for entry in list(ee_frame.point)], list(ee_frame.quaternion)]
print values_for_robotstudio

print ee_frame.quaternion.x
print ee_frame.quaternion.y
print ee_frame.quaternion.z
print ee_frame.quaternion.w
# ---------- end tool ----------

# ---- group: sgraffito tool
geo_2 = Geometry(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)
mesh_2 = Mesh(geo_2)
mjoin_2 = MeshJoin(Meshes=mesh_2)
yaxis_line_2 = Curve(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)
xaxis_line_2 = Curve(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)

# ----
tool_2 = PythonScript(rhmesh=mjoin_2, xline=xaxis_line_2, yline=yaxis_line_2)  # -> tool; inputs rhmesh: Mesh
# ---------- tool_2: Python ----------
import Rhino.Geometry as rg
import os, math
from compas.geometry import Frame, Rotation
from compas.datastructures import Mesh
from compas_ghpython.artists import MeshArtist
from compas_fab.robots import Tool
from compas_rhino.geometry import RhinoMesh

xaxis = rg.Line(xline.PointAtStart, xline.PointAtEnd)
yaxis = rg.Line(yline.PointAtStart, yline.PointAtEnd)

if xaxis.From.DistanceTo(yaxis.From) < 0.01:
    origin = xaxis.From
    xaxis = xaxis.Direction
    yaxis = yaxis.Direction
elif xaxis.To.DistanceTo(yaxis.To) < 0.01:
    origin = xaxis.To
    xaxis = -xaxis.Direction
    yaxis = -yaxis.Direction
elif xaxis.From.DistanceTo(yaxis.To) < 0.01:
    origin = xaxis.From
    xaxis = xaxis.Direction
    yaxis = -yaxis.Direction
elif xaxis.To.DistanceTo(yaxis.From) < 0.01:
    origin = xaxis.To
    xaxis = -xaxis.Direction
    yaxis = yaxis.Direction

xaxis.Unitize()
yaxis.Unitize()

ee_frame = Frame(origin, xaxis, yaxis)
ee_mesh = RhinoMesh.from_geometry(rhmesh).to_compas()

tool = Tool(ee_mesh, ee_frame, collision=None, name="t_sgraffito")

values_for_robotstudio = [[round(entry*1000, 5) for entry in list(ee_frame.point)], list(ee_frame.quaternion)]
print values_for_robotstudio


print ee_frame.quaternion.x
print ee_frame.quaternion.y
print ee_frame.quaternion.z
print ee_frame.quaternion.w
# ---------- end tool_2 ----------
G = ClusterInput()
filter = StreamFilter(Gate=G, Stream0=tool, Stream1=tool_2)
s_1 = ClusterOutput(filter)
